# Dynamo graph ReplaceTextNotesBasedOnExcelDictionary.dyn (Dynamo 3.3.0.6316)
# packages: Clockwork for Dynamo 3.x 3.3.0

# group: Filtering sheets based on a sheet grouping parameter value
categories = Categories("OST_Sheets")
all_elements_of_category = ElementsOfCategory(Category=categories)
sheet_grouping_parameter_name = StringInput("Filter Grouping")  # graph input
getParameterValueByName = Element.GetParameterValueByName(element=all_elements_of_category, parameterName=sheet_grouping_parameter_name)
sheet_grouping_parameter_value = StringInput("Group1")  # graph input
eq = getParameterValueByName == sheet_grouping_parameter_value
filterByBoolMask = List.FilterByBoolMask(list=all_elements_of_category, mask=eq)

# group: Getting all text notes inside sheets and views
categories_2 = Categories("OST_TextNotes")
all_elements_of_category_2 = ElementsOfCategory(Category=categories_2)
views = Sheet.Views(sheet=filterByBoolMask.in)
list_create = List.Create(item0=filterByBoolMask.in, item1=views)
flatten = List.Flatten(list=list_create)
ownerView = Custom[Element.OwnerView](element=all_elements_of_category_2)  # package Clockwork for Dynamo 3.x; Gets the owner view of a given Revit element (if possible)
contains = List.Contains(list=flatten@L2, item=ownerView@L1, lacing=CrossProduct)
code_block = CodeBlock { 1; }
flatten_2 = List.Flatten(list=contains, amount=code_block)
filterByBoolMask_2 = List.FilterByBoolMask(list=all_elements_of_category_2, mask=flatten_2)
text = TextNote.Text(textNote=filterByBoolMask_2.in)

# group: Importing excel data
dictionary_file_location = Filename(".\Dictionary.xlsx")  # graph input
file_from_path = FileObject(path=dictionary_file_location)
dictionry_sheet_name = StringInput("Sheet1")  # graph input
boolean = BoolSelector(true)
boolean_2 = BoolSelector(false)
importExcel = Data.ImportExcel(file=file_from_path, sheetName=dictionry_sheet_name, readAsStrings=boolean, showExcel=boolean_2)
watch = Watch(importExcel)
transpose = List.Transpose(lists=watch)
code_block_2 = CodeBlock { 0; }
removeItemAtIndex = List.RemoveItemAtIndex(list=transpose, indices=code_block_2, lacing=Longest)
code_block_3 = CodeBlock(list=removeItemAtIndex) { list[0]; list[1]; }
watch_2 = Watch(code_block_3.out0)
watch_3 = Watch(code_block_3.out1)

# group: Replacing text notes
python_script = Python(IN[0]=text, IN[1]=watch_2, IN[2]=watch_3, IN[3]=filterByBoolMask_2.in)  # CPython3
# ---------- python_script.python (125 lines) ----------
import clr
import re

clr.AddReference("RevitServices")
import RevitServices
from RevitServices.Transactions import TransactionManager

# Safely unpack inputs
text_inputs = IN[0] if isinstance(IN[0], list) else [IN[0]]
old_inputs   = IN[1] if isinstance(IN[1], list) else [IN[1]]
new_inputs   = IN[2] if isinstance(IN[2], list) else [IN[2]]

# Unwrap elements
revit_notes = (
    UnwrapElement(IN[3])
    if isinstance(IN[3], list)
    else [UnwrapElement(IN[3])]
)

# Clean find/replace lists
old_words = [str(x) if x is not None else "" for x in old_inputs]
new_words = [str(y) if y is not None else "" for y in new_inputs]

doc = RevitServices.Persistence.DocumentManager.Instance.CurrentDBDocument

TransactionManager.Instance.EnsureInTransaction(doc)

output_strings = []

# Loop through every element and corresponding text
for note_element, original_text in zip(revit_notes, text_inputs):

    if note_element is None or original_text is None:
        output_strings.append("")
        continue

    current_text = str(original_text)
    has_changed = False

    # Run through find/replace pairs sequentially
    for old, new in zip(old_words, new_words):

        # Skip empty find values
        if old.strip() == "":
            continue

        # -------------------------------------------------
        # WHOLE WORD REPLACEMENT
        #
        # \b prevents replacing part of another word.
        #
        # Example:
        # "is" -> "was"
        #
        # "is"       becomes "was"
        # "This is"  becomes "This was"
        # "wish"     stays "wish"
        # "isometric" stays "isometric"
        # -------------------------------------------------

        pattern = r"\b" + re.escape(old) + r"\b"

        # Case-sensitive replacement
        new_text, count = re.subn(
            pattern,
            new,
            current_text
        )

        if count > 0:
            current_text = new_text
            has_changed = True

        # -------------------------------------------------
        # Handle uppercase version
        # -------------------------------------------------

        old_upper = old.upper()
        new_upper = new.upper()

        if old_upper != old:
            pattern_upper = r"\b" + re.escape(old_upper) + r"\b"

            new_text, count = re.subn(
                pattern_upper,
                new_upper,
                current_text
            )

            if count > 0:
                current_text = new_text
                has_changed = True

        # -------------------------------------------------
        # Handle Capitalized version
        # -------------------------------------------------

        old_cap = old.capitalize()
        new_cap = new.capitalize()

        if old_cap != old and old_cap != old_upper:
            pattern_cap = r"\b" + re.escape(old_cap) + r"\b"

            new_text, count = re.subn(
                pattern_cap,
                new_cap,
                current_text
            )

            if count > 0:
                current_text = new_text
                has_changed = True

    # Push changed text back into Revit
    if has_changed:
        try:
            note_element.Text = current_text
        except:
            pass

    output_strings.append(current_text)

TransactionManager.Instance.TransactionTaskDone()

OUT = output_strings
# ----------------------------------------
watch_4 = Watch(python_script)

# group: Creating output showing list of sheet numbers and their updated text notes
code_block_4 = CodeBlock(x=text, y=watch_4) { x != y; }
filterByBoolMask_3 = List.FilterByBoolMask(list=filterByBoolMask_2.in, mask=code_block_4)
ownerView_2 = Custom[Element.OwnerView](element=filterByBoolMask_3.in)
string = StringInput("Sheet Number")
getParameterValueByName_2 = Element.GetParameterValueByName(element=ownerView_2, parameterName=string)
text_2 = TextNote.Text(textNote=filterByBoolMask_3.in)
code_block_5 = CodeBlock(sheetNum=getParameterValueByName_2, newText=text_2) { "Sheet: " + sheetNum + " | Updated Text: " + newText; }
watch_5 = Watch(code_block_5)  # graph output
