# Dynamo graph ModelParameters.dyn "Category Elements Parameter" (Dynamo 3.3.0.6316)

# group: Collecting 3D elements
# Python script that would collect 3D elements and filter out non physical elements such as lines, rooms, spaces, and etc
element_collector_python_script = Python()  # CPython3; unwired: IN[0]
# ---------- element_collector_python_script.python (62 lines) ----------
import clr
clr.AddReference('RevitAPI')
from Autodesk.Revit.DB import *

clr.AddReference('RevitServices')
import RevitServices
from RevitServices.Persistence import DocumentManager

doc = DocumentManager.Instance.CurrentDBDocument

# 1. Grab all element instances globally across the database background
collector = FilteredElementCollector(doc).WhereElementIsNotElementType()

physical_elements = []

geo_options = Options()
geo_options.DetailLevel = ViewDetailLevel.Coarse

# 2. Fully dynamic evaluation loop with exception handling
for elem in collector:
    if elem is None:
        continue
        
    cat = elem.Category
    if cat is None:
        continue # Drops non-graphical internal data maps
        
    # Check if this category belongs to the 3D Model environment
    if cat.CategoryType != CategoryType.Model:
        continue # Excludes annotations, schedules, views, and sheets
        
    # CRITICAL CHANGE: Skip Spatial Elements (Rooms/Spaces/Areas) completely 
    if isinstance(elem, SpatialElement):
        continue

    # 3. DEFENSIVE CHECK: Ensure the object actually supports geometry properties 
    if not hasattr(elem, "get_Geometry"):
        continue

    # 4. Geometry Check (Separates true physical volumes from lines/curves)
    geo_elem = elem.get_Geometry(geo_options)
    if geo_elem is None:
        continue
        
    has_solid = False
    for geo_obj in geo_elem:
        if isinstance(geo_obj, Solid) and geo_obj.Faces.Size > 0:
            has_solid = True
            break
        elif isinstance(geo_obj, GeometryInstance):
            instance_geo = geo_obj.GetInstanceGeometry()
            for sub_obj in instance_geo:
                if isinstance(sub_obj, Solid) and sub_obj.Faces.Size > 0:
                    has_solid = True
                    break
                    
    # 5. Keep only true physical volumes
    if has_solid:
        physical_elements.append(elem)

# Output clean instances directly to visual nodes
OUT = physical_elements
# ----------------------------------------

# group: Getting Element Parameters
# Collecting element parameters namely element ID, type, name, category, level, area, volume, length, mark, comments, phase created, and workset
id = Element.Id(element=element_collector_python_script)
elementType = Element.ElementType(element=element_collector_python_script)
code_block = CodeBlock(t=elementType) { t.FamilyName; }
name = Element.Name(element=element_collector_python_script)
string = StringInput(",")
string_2 = StringInput("")
replace = String.Replace(string=name, searchFor=string, replaceWith=string_2)
getCategory = Element.GetCategory(element=element_collector_python_script)
string_3 = StringInput("Level")
parameterByName = Parameter.ParameterByName(element=element_collector_python_script, name=string_3)
string_4 = StringInput("Area")
parameterByName_2 = Parameter.ParameterByName(element=element_collector_python_script, name=string_4)
string_5 = StringInput("Volume")
parameterByName_3 = Parameter.ParameterByName(element=element_collector_python_script, name=string_5)
string_6 = StringInput("Length")
parameterByName_4 = Parameter.ParameterByName(element=element_collector_python_script, name=string_6)
string_7 = StringInput("Mark")
parameterByName_5 = Parameter.ParameterByName(element=element_collector_python_script, name=string_7)
string_8 = StringInput("Comments")
parameterByName_6 = Parameter.ParameterByName(element=element_collector_python_script, name=string_8)
string_9 = StringInput("Phase Created")
parameterByName_7 = Parameter.ParameterByName(element=element_collector_python_script, name=string_9)
string_10 = StringInput("Workset")
parameterByName_8 = Parameter.ParameterByName(element=element_collector_python_script, name=string_10)

# group: Creating List
# Arranging the element parameters into a list and placing column names on top of list
code_block_2 = CodeBlock()
# ---------- code_block_2.designscript (12 lines) ----------
"Element ID";
"Family";
"Type";
"Category";
"Level";
"Area";
"Volume";
"Length";
"Mark";
"Comments";
"Phase Created";
"Workset";
# ----------------------------------------
list_create = List.Create(item0=code_block_2.out0, item1=code_block_2.out1, item2=code_block_2.out2, item3=code_block_2.out3, item4=code_block_2.out4, item5=code_block_2.out5, item6=code_block_2.out6, item7=code_block_2.out7, item8=code_block_2.out8, item9=code_block_2.out9, item10=code_block_2.out10, item11=code_block_2.out11)
list_create_2 = List.Create(item0=id, item1=code_block, item2=replace, item3=getCategory, item4=parameterByName, item5=parameterByName_2, item6=parameterByName_3, item7=parameterByName_4, item8=parameterByName_5, item9=parameterByName_6, item10=parameterByName_7, item11=parameterByName_8)
transpose = List.Transpose(lists=list_create_2)
addItemToFront = List.AddItemToFront(item=list_create, list=transpose)

# group: Exporting Data to CSV file
# Exporting a ModelParameters.csv to the specified file location.
file_location = Filename("Test Files\ModelParameters.csv")  # graph input
exportCSV = Data.ExportCSV(filePath=file_location, data=addItemToFront)
