# Dynamo graph ProjectInfo&Warnings.dyn (Dynamo 3.3.0.6316)
# packages: Clockwork for Dynamo 3.x 3.3.0

# group: Errors and Warnings
current = Document.Current()
getWarnings = Warning.GetWarnings(document=current)
getFailingElements = Warning.GetFailingElements(warning=getWarnings)
id = Element.Id(element=getFailingElements@L2)
code_block = CodeBlock { 2; }
flatten = List.Flatten(list=id, amount=code_block)
description = Warning.Description(warning=getWarnings@L1)
count = List.Count(list=id@L2)
ofRepeatedItem = List.OfRepeatedItem(item=description@L1, amount=count@L1)
code_block_2 = CodeBlock { 2; }
flatten_2 = List.Flatten(list=ofRepeatedItem, amount=code_block_2)
code_block_3 = CodeBlock(A=flatten_2) { '"' + A + '"'; }

# group: Exporting to CSV - Warnings.csv
file_path = Filename("Test Files\Warnings.csv")
code_block_4 = CodeBlock { "Element ID"; "Warnings"; }
list_create = List.Create(item0=code_block_4.out0, item1=code_block_4.out1)
list_create_2 = List.Create(item0=flatten, item1=code_block_3)
transpose = List.Transpose(lists=list_create_2)
addItemToFront = List.AddItemToFront(item=list_create, list=transpose)
watch = Watch(addItemToFront)
exportCSV = Data.ExportCSV(filePath=file_path, data=watch)

# group: Number of Links
current_2 = Document.Current()
getLinkInstances = Document.GetLinkInstances(document=current_2)
count_2 = List.Count(list=getLinkInstances)
watch_2 = Watch(count_2)

# group: File Size
current_3 = Document.Current()
filePath = Document.FilePath(document=current_3)
file_from_path = FileObject(path=filePath)
fileSize = Custom[FileSystem.FileSize](file=file_from_path)  # package Clockwork for Dynamo 3.x; Returns the file size of a given file.
watch_3 = Watch(fileSize.megabytes)

# group: Exporting to CSV - ProjectInfo.csv
file_path_2 = Filename("Test Files\ProjectInfo.csv")
code_block_5 = CodeBlock { "Number of Links"; "File Size"; }
list_create_3 = List.Create(item0=code_block_5.out0, item1=code_block_5.out1)
list_create_4 = List.Create(item0=watch_2, item1=watch_3)
transpose_2 = List.Transpose(lists=list_create_4@L2)
addItemToFront_2 = List.AddItemToFront(item=list_create_3, list=transpose_2)
watch_4 = Watch(addItemToFront_2)
exportCSV_2 = Data.ExportCSV(filePath=file_path_2, data=watch_4)
